# Dynamo graph AnnotationDimensionWall_script.dyn (Dynamo 3.3.0.6316)
# packages: archi-lab.net 2018.0.6, Data-Shapes 2025.3.119, spring nodes 121.0.2, Genius Loci 2023.7.13, Crumple 2024.4.3, archi-lab.net 2025.300.1225

# group: Select Dimension Style
code_block = CodeBlock { "SELECT DIMENSION STYLE"; }
get_all_dimension_styles = Custom[Get All Dimension Styles]()  # package archi-lab.net; This node will query all of the available dimension styles (this includes linear as well as arc, circle etc).
name = Element.Name(element=get_all_dimension_styles)
ui_dropdown_data = Custom[UI.DropDown Data](InputName=code_block, Keys=name, Values=name)  # package Data-Shapes; Create data for DropDown input in UI.MultiInputForm ++ . Check out www.data-shapes.net for more infos.

# group: Select Views
code_block_2 = CodeBlock { "SELECT VIEW"; }
collect_views = Custom[© Collect.Views]()  # package Crumple; Returns all views in a document. Excludes system views, templates, legends and schedule instances.
name_2 = Element.Name(element=collect_views)
dropdown_data = Custom[DropDown Data](InputName=code_block_2, Keys=name_2, Values=collect_views)  # package Data-Shapes; Create data for DropDown input in UI.MultiInputForm ++ . Check out www.data-shapes.net for more infos.

# group: UI
code_block_3 = CodeBlock { "CANCEL"; "WALL DIMENSION"; "CREATE"; 600; 250; }
list_create = List.Create(item0=ui_dropdown_data, item1=dropdown_data)
boolean = BoolSelector(true)
ui_multipleinputform = Custom[UI.MultipleInputForm ++](Description_optional=code_block_3.out1, ButtonText_optional=code_block_3.out2, Inputs=list_create, Toggle=boolean, CancelButtonText_optional=code_block_3.out0, MaxHeight_optional=code_block_3.out3, Width_optional=code_block_3.out3, LabelWidth_optional=code_block_3.out4)  # package Data-Shapes; Create a form with multiple inputs. see www.data-shapes.net for tutorials and infos!

code_block_4 = CodeBlock(Out=ui_multipleinputform.User_Inputs) { dia = Out[0]; view = Out[1]; }
viewTemplate = archilab.Revit.Views.Views.ViewTemplate(view=code_block_4.view)
string_from_object = FromObject(obj=viewTemplate)
string_from_object_2 = FromObject(obj=code_block_4.view)
eq = string_from_object == string_from_object_2
views = List.FilterByBoolMask(list=code_block_4.view, mask=eq)

# group: Select family category
category = Categories("OST_Walls")  # graph input
ꟿ_collect_elementsinview = Custom[ꟿ Collect.ElementsInView](view=views.out, category=category)  # package spring nodes; Selects all elements visible in the input view.
isEmpty = List.IsEmpty(list=ꟿ_collect_elementsinview, lacing=Longest)
filterByBoolMask = List.FilterByBoolMask(list=ꟿ_collect_elementsinview, mask=isEmpty)
flatten = List.Flatten(list=filterByBoolMask.out)
python_script = Python(IN[0]=flatten)  # IronPython2
# ---------- python_script.python (84 lines) ----------
import clr
clr.AddReference('RevitAPI')
from Autodesk.Revit.DB import *

clr.AddReference('RevitNodes')
import Revit
clr.ImportExtensions(Revit.GeometryConversion)

# ---------- Helper Functions ----------
def is_vertical(edge):
    c = edge.AsCurve()
    if not isinstance(c, Line):  # remove NURBS and Arcs
        return False
    p0 = c.GetEndPoint(0)
    p1 = c.GetEndPoint(1)
    # vertical check (X,Y constant, Z changes)
    return abs(p0.X - p1.X) < 0.001 and abs(p0.Y - p1.Y) < 0.001 and abs(p0.Z - p1.Z) > 0.001

# ---------- Input ----------
items = UnwrapElement(IN[0])
if not hasattr(items, '__iter__'):
    items = [items]

# ---------- Output Containers ----------
allExtEdges = []
allIntEdges = []
allExtReferences = []
allIntReferences = []

opt = Options()
opt.ComputeReferences = True

# ---------- Main Loop ----------
for item in items:
    extFaces = []
    intFaces = []

    # Collect wall external faces
    for rf in HostObjectUtils.GetSideFaces(item, ShellLayerType.Exterior):
        extFaces.append(item.GetGeometryObjectFromReference(rf))
    # Collect wall internal faces
    for rf in HostObjectUtils.GetSideFaces(item, ShellLayerType.Interior):
        intFaces.append(item.GetGeometryObjectFromReference(rf))

    extEdges = []
    intEdges = []
    extRefs = []
    intRefs = []

    # Loop geometry
    for obj in item.get_Geometry(opt):
        if isinstance(obj, Solid):
            for edge in obj.Edges:

                # Only use vertical straight lines
                if not is_vertical(edge):
                    continue

                # Exterior
                if edge.GetFace(0) in extFaces:
                    extEdges.append(edge.AsCurve().ToProtoType())
                    extRefs.append(edge.Reference)

                # Interior
                if edge.GetFace(0) in intFaces:
                    intEdges.append(edge.AsCurve().ToProtoType())
                    intRefs.append(edge.Reference)

    allExtEdges.append(extEdges)
    allExtReferences.append(extRefs)
    allIntEdges.append(intEdges)
    allIntReferences.append(intRefs)

# ---------- Output Formatting ----------
if isinstance(IN[0], (list)):
    OUT = (filter(None, allExtEdges),
           filter(None, allExtReferences),
           filter(None, allIntEdges),
           filter(None, allIntReferences))
else:
    OUT = (filter(None, allExtEdges)[0],
           filter(None, allExtReferences)[0],
           filter(None, allIntEdges)[0],
           filter(None, allIntReferences)[0])
# ----------------------------------------
code_block_5 = CodeBlock(out=python_script) { HEXLi = out[0]; HEXRef = out[1]; }
flatten_2 = List.Flatten(list=filterByBoolMask.out)
python_script_2 = Python(IN[0]=flatten_2)  # IronPython2
# ---------- python_script_2.python (82 lines) ----------
import clr
clr.AddReference('RevitAPI')
from Autodesk.Revit.DB import *

clr.AddReference('RevitNodes')
import Revit
clr.ImportExtensions(Revit.GeometryConversion)

# ---------- Helper Functions ----------
def is_horizontal(edge):
    c = edge.AsCurve()
    # Only straight line
    if not isinstance(c, Line):
        return False
    p0 = c.GetEndPoint(0)
    p1 = c.GetEndPoint(1)
    # Horizontal check (Z same)
    return abs(p0.Z - p1.Z) < 0.001

# ---------- Input ----------
items = UnwrapElement(IN[0])
if not hasattr(items, '__iter__'):
    items = [items]

# ---------- Output Containers ----------
allExtHEdges = []
allExtHRefs = []
allIntHEdges = []
allIntHRefs = []

opt = Options()
opt.ComputeReferences = True

# ---------- Main ----------
for item in items:
    extFaces = []
    intFaces = []

    # Collect faces
    for rf in HostObjectUtils.GetSideFaces(item, ShellLayerType.Exterior):
        extFaces.append(item.GetGeometryObjectFromReference(rf))
    for rf in HostObjectUtils.GetSideFaces(item, ShellLayerType.Interior):
        intFaces.append(item.GetGeometryObjectFromReference(rf))

    extHEdges = []
    extHRefs = []
    intHEdges = []
    intHRefs = []

    # Loop geometry
    for obj in item.get_Geometry(opt):
        if isinstance(obj, Solid):
            for edge in obj.Edges:

                # horizontal only
                if not is_horizontal(edge):
                    continue

                if edge.GetFace(0) in extFaces:
                    extHEdges.append(edge.AsCurve().ToProtoType())
                    extHRefs.append(edge.Reference)

                if edge.GetFace(0) in intFaces:
                    intHEdges.append(edge.AsCurve().ToProtoType())
                    intHRefs.append(edge.Reference)

    allExtHEdges.append(extHEdges)
    allExtHRefs.append(extHRefs)
    allIntHEdges.append(intHEdges)
    allIntHRefs.append(intHRefs)

# ---------- Output ----------
if isinstance(IN[0], (list)):
    OUT = (filter(None, allExtHEdges),
           filter(None, allExtHRefs),
           filter(None, allIntHEdges),
           filter(None, allIntHRefs))
else:
    OUT = (filter(None, allExtHEdges)[0],
           filter(None, allExtHRefs)[0],
           filter(None, allIntHEdges)[0],
           filter(None, allIntHRefs)[0])
# ----------------------------------------
code_block_6 = CodeBlock(out=python_script_2) { VEXLi = out[0]; VEXRef = out[1]; }
python_script_3 = Python(IN[0]=flatten)  # IronPython2; same code as python_script
code_block_7 = CodeBlock(out=python_script_3) { HEXLi = out[2]; HEXRef = out[3]; }
python_script_4 = Python(IN[0]=flatten_2)  # IronPython2; same code as python_script_2
code_block_8 = CodeBlock(out=python_script_4) { VEXLi = out[2]; VEXRef = out[3]; }

eq_2 = name == code_block_4.dia  # lacing=Longest
filterByBoolMask_2 = List.FilterByBoolMask(list=get_all_dimension_styles, mask=eq_2)

# group: DIMENSIONS H-01
list_create_2 = List.Create(item0=code_block_5.HEXLi)
flatten_3 = List.Flatten(list=list_create_2)
YAxis = Vector.YAxis()
number_slider = DoubleSlider(200, range=100..10000 step 100)
code_block_9 = CodeBlock { 1; }
mul = number_slider * code_block_9
translate = Geometry.Translate(geometry=flatten_3@L2, direction=YAxis, distance=mul)
list_create_3 = List.Create(item0=translate)
flatten_4 = List.Flatten(list=list_create_3)
list_create_4 = List.Create(item0=code_block_5.HEXRef)
flatten_5 = List.Flatten(list=list_create_4)
dimension_byreferences = Custom[Dimension ByReferences](view=views.out, line=flatten_4, references=flatten_5, dimensionType=filterByBoolMask_2.in)  # package Genius Loci; Creates a new linear dimension from at least two geometric references of an object.
XAxis = Vector.XAxis()

# group: DIMENSIONS V-01
list_create_5 = List.Create(item0=code_block_6.VEXLi)
flatten_6 = List.Flatten(list=list_create_5)
ZAxis = Vector.ZAxis()
number_slider_2 = DoubleSlider(400, range=100..10000 step 100)
code_block_10 = CodeBlock { 1; }
mul_2 = number_slider_2 * code_block_10
translate_2 = Geometry.Translate(geometry=flatten_6@L2, direction=ZAxis, distance=mul_2)
list_create_6 = List.Create(item0=translate_2)
flatten_7 = List.Flatten(list=list_create_6)
list_create_7 = List.Create(item0=code_block_6.VEXRef)
flatten_8 = List.Flatten(list=list_create_7)
dimension_byreferences_2 = Custom[Dimension ByReferences](view=views.out, line=flatten_7, references=flatten_8, dimensionType=filterByBoolMask_2.in)

# group: DIMENSIONS V-02
list_create_8 = List.Create(item0=code_block_6.VEXLi)
flatten_9 = List.Flatten(list=list_create_8)
firstItem = List.FirstItem(list=flatten_9)
lastItem = List.LastItem(list=flatten_9)
list_create_9 = List.Create(item0=firstItem, item1=lastItem)
ZAxis_2 = Vector.ZAxis()
number_slider_3 = DoubleSlider(200, range=100..10000 step 100)
code_block_11 = CodeBlock { 1; }
mul_3 = number_slider_3 * code_block_11
translate_3 = Geometry.Translate(geometry=list_create_9@L2, direction=ZAxis_2, distance=mul_3)
list_create_10 = List.Create(item0=translate_3)
flatten_10 = List.Flatten(list=list_create_10)
list_create_11 = List.Create(item0=code_block_6.VEXRef)
flatten_11 = List.Flatten(list=list_create_11)
firstItem_2 = List.FirstItem(list=flatten_11)
lastItem_2 = List.LastItem(list=flatten_11)
list_create_12 = List.Create(item0=firstItem_2, item1=lastItem_2)
dimension_byreferences_3 = Custom[Dimension ByReferences](view=views.out, line=flatten_10, references=list_create_12, dimensionType=filterByBoolMask_2.in)

# group: DIMENSIONS H-02
list_create_13 = List.Create(item0=code_block_5.HEXLi)
flatten_12 = List.Flatten(list=list_create_13)
firstItem_3 = List.FirstItem(list=flatten_12)
lastItem_3 = List.LastItem(list=flatten_12)
list_create_14 = List.Create(item0=firstItem_3, item1=lastItem_3)
YAxis_2 = Vector.YAxis()
number_slider_4 = DoubleSlider(400, range=100..10000 step 100)
code_block_12 = CodeBlock { 1; }
mul_4 = number_slider_4 * code_block_12
translate_4 = Geometry.Translate(geometry=list_create_14@L2, direction=YAxis_2, distance=mul_4)
list_create_15 = List.Create(item0=translate_4)
flatten_13 = List.Flatten(list=list_create_15)
list_create_16 = List.Create(item0=code_block_5.HEXRef)
flatten_14 = List.Flatten(list=list_create_16)
firstItem_4 = List.FirstItem(list=flatten_14)
lastItem_4 = List.LastItem(list=flatten_14)
list_create_17 = List.Create(item0=firstItem_4, item1=lastItem_4)
dimension_byreferences_4 = Custom[Dimension ByReferences](view=views.out, line=flatten_13, references=list_create_17, dimensionType=filterByBoolMask_2.in)
XAxis_2 = Vector.XAxis()

# group: DIMENSIONS H-03
list_create_18 = List.Create(item0=code_block_7.HEXLi)
flatten_15 = List.Flatten(list=list_create_18)
YAxis_3 = Vector.YAxis()
number_slider_5 = DoubleSlider(600, range=100..10000 step 100)
code_block_13 = CodeBlock { 1; }
mul_5 = number_slider_5 * code_block_13
translate_5 = Geometry.Translate(geometry=flatten_15@L2, direction=YAxis_3, distance=mul_5)
list_create_19 = List.Create(item0=translate_5)
flatten_16 = List.Flatten(list=list_create_19)
list_create_20 = List.Create(item0=code_block_7.HEXRef)
flatten_17 = List.Flatten(list=list_create_20)
dimension_byreferences_5 = Custom[Dimension ByReferences](view=views.out, line=flatten_16, references=flatten_17, dimensionType=filterByBoolMask_2.in)
XAxis_3 = Vector.XAxis()

# group: DIMENSIONS V-03
list_create_21 = List.Create(item0=code_block_8.VEXLi)
flatten_18 = List.Flatten(list=list_create_21)
ZAxis_3 = Vector.ZAxis()
number_slider_6 = DoubleSlider(600, range=100..10000 step 100)
code_block_14 = CodeBlock { -1; }
mul_6 = number_slider_6 * code_block_14
translate_6 = Geometry.Translate(geometry=flatten_18@L2, direction=ZAxis_3, distance=mul_6)
list_create_22 = List.Create(item0=translate_6)
flatten_19 = List.Flatten(list=list_create_22)
list_create_23 = List.Create(item0=code_block_8.VEXRef)
flatten_20 = List.Flatten(list=list_create_23)
dimension_byreferences_6 = Custom[Dimension ByReferences](view=views.out, line=flatten_19, references=flatten_20, dimensionType=filterByBoolMask_2.in)
