# Dynamo graph Export PDF & DWG By ViewSets With Production and Shop_script.dyn (Dynamo 3.3.0.6316)
# packages: Crumple 2024.4.3, Clockwork for Dynamo 3.x 3.3.0, Data-Shapes 2025.3.119

code_block = CodeBlock { "Select Sheets"; "Cancel"; "Set"; 500; }

# group: Inputs Of Shop Drawings
code_block_2 = CodeBlock { "Select View Set"; }
collect_viewsheetsets = Custom[© Collect.ViewSheetSets]()  # package Crumple; Returns all view sheet sets in the target document.
name = Element.Name(element=collect_viewsheetsets)
dropdown_data = Custom[DropDown Data](InputName=code_block_2, Keys=name, Values=collect_viewsheetsets)  # package Data-Shapes; Create data for DropDown input in UI.MultiInputForm ++ . Check out www.data-shapes.net for more infos.

# group: Inputs of Production Drawings
code_block_3 = CodeBlock { "Select View Set"; }
collect_viewsheetsets_2 = Custom[© Collect.ViewSheetSets]()
name_2 = Element.Name(element=collect_viewsheetsets_2)
dropdown_data_2 = Custom[DropDown Data](InputName=code_block_3, Keys=name_2, Values=collect_viewsheetsets_2)

# group: Additional Inputs
code_block_4 = CodeBlock { "Select PDF Path"; }
directorypath_data = Custom[DirectoryPath Data](InputName=code_block_4)  # package Data-Shapes; Creates a DirectoryPath input for UI.MultipleInputForm ++ . Check out www.data-shapes.net for more infos!
code_block_5 = CodeBlock { "Select DWG Path"; }
directorypath_data_2 = Custom[DirectoryPath Data](InputName=code_block_5)
code_block_6 = CodeBlock { "DWG Files"; }
boolean_input = Custom[Boolean input](InputName=code_block_6)  # package Data-Shapes; Creates a boolean input for UI.MultipleInputForm ++ . Check out www.data-shapes.net for more infos!

list_create = List.Create(item0=dropdown_data, item1=dropdown_data_2, item2=directorypath_data, item3=directorypath_data_2, item4=boolean_input)
boolean = BoolSelector(true)
multipleinputform = Custom[MultipleInputForm ++](Description_optional=code_block.out0, Inputs=list_create, Toggle=boolean, CancelButtonText_optional=code_block.out1, MaxHeight_optional=code_block.out3)  # package Data-Shapes; Create a form with multiple inputs. see www.data-shapes.net for tutorials and infos!
code_block_7 = CodeBlock(A=multipleinputform.User_Inputs) { A[0]; A[1]; A[2]; A[3]; A[4]; }
list_create_2 = List.Create(item0=code_block_7.out0, item1=code_block_7.out1)

# group: Parameter Values
viewsheetsets_views = Custom[© ViewSheetSets.Views](viewSheetSet=list_create_2)  # package Crumple; Return all views and sheets in the view sheet set(s).
code_block_8 = CodeBlock(a=viewsheetsets_views) { a[0]; a[1]; }
code_block_9 = CodeBlock()
# ---------- code_block_9.designscript (7 lines) ----------
"Sh.02.Work Package";
"Sh.03.Originator";
"Sh.04.Area";
"Sh.05.Building Work";
"Sh.06.Level";
"Sh.07.File Type";
"Sh.08.Discipline";
# ----------------------------------------
getParameterValueByName = Element.GetParameterValueByName(element=code_block_8.out0, parameterName=code_block_9.out0)
getParameterValueByName_2 = Element.GetParameterValueByName(element=code_block_8.out0, parameterName=code_block_9.out1)
getParameterValueByName_3 = Element.GetParameterValueByName(element=code_block_8.out0, parameterName=code_block_9.out2)
getParameterValueByName_4 = Element.GetParameterValueByName(element=code_block_8.out0, parameterName=code_block_9.out3)
getParameterValueByName_5 = Element.GetParameterValueByName(element=code_block_8.out0, parameterName=code_block_9.out4)
getParameterValueByName_6 = Element.GetParameterValueByName(element=code_block_8.out0, parameterName=code_block_9.out5)
getParameterValueByName_7 = Element.GetParameterValueByName(element=code_block_8.out0, parameterName=code_block_9.out6)
sheetNumber = Sheet.SheetNumber(sheet=code_block_8.out0)
sheetName = Sheet.SheetName(sheet=code_block_8.out0)
list_create_3 = List.Create(item0=getParameterValueByName, item1=getParameterValueByName_2, item2=getParameterValueByName_3, item3=getParameterValueByName_4, item4=getParameterValueByName_5, item5=getParameterValueByName_6, item6=getParameterValueByName_7, item7=sheetNumber, item8=sheetName)

flatten = List.Flatten(list=viewsheetsets_views)

# group: Project Number(Shop Drawings)
projectInfo = Custom[Document.ProjectInfo]()  # package Clockwork for Dynamo 3.x; Gets the project information.
code_block_10 = CodeBlock { "-"; }
transpose = List.Transpose(lists=list_create_3)
join = String.Join(separator=code_block_10, string0=transpose, lacing=Longest)
code_block_11 = CodeBlock(a=projectInfo.Number, b=join) { a+"-"+b; }

# group: Project Number(Production Drawings)
code_block_12 = CodeBlock { "Sh.01.Project Number"; }
parameters_projectinformation = Custom[© Parameters.ProjectInformation](params=code_block_12)  # package Crumple; Retrieve project information field(s) by name.
name_3 = Element.Name(element=code_block_8.out1)
add = parameters_projectinformation + name_3  # lacing=CrossProduct
code_block_13 = CodeBlock(a=parameters_projectinformation, b=add) { a+ "-" +b; }

list_create_4 = List.Create(item0=code_block_11, item1=code_block_13)

# group: PDF & DWG Export
flatten_2 = List.Flatten(list=list_create_4)
boolean_2 = BoolSelector(true)
revit_exportoptionspdf = Custom[© Revit.ExportOptionsPdf](hideCrop=boolean_2, hideScopeBoxes=boolean_2, hideRefPlanes=boolean_2, hideUnreferenced=boolean_2, maskCoincident=boolean_2)  # package Crumple; Provides a list of options to be used in conjunction with the ExportPDF node. Works in Revit 2022 and later.
revit_exporttopdf = Custom[© Revit.ExportToPdf](directoryPath=code_block_7.out2, sheets=flatten, fileNames=flatten_2, options=revit_exportoptionspdf)  # package Crumple; Given a list of sheets, names, directory and export options this node will batch export PDF files. Requires Revit 2022 or higher to work.
revit_exportoptionsdwg = Custom[© Revit.ExportOptionsDwg]()  # package Crumple; Creates a DWG export options object, or retrieves one with the given name if found in the document.
revit_exporttodwg = Custom[© Revit.ExportToDwg](directoryPath=code_block_7.out3, viewsOrSheets=flatten, fileNames=flatten_2, dwgExportOptions=revit_exportoptionsdwg.dwgExportOptions, runMe=code_block_7.out4)  # package Crumple; Given a list of views and/or sheets as well as various related settings, attempts to export them to DWG using the provided settings.
