# Dynamo graph Create Wall Name_script.dyn (Dynamo 3.3.0.6316)
# packages: Data-Shapes 2025.3.119, Genius Loci 2023.7.13, Ampersand 2017.2.2

# group: UI
code_block = CodeBlock { "ASSIGN NAMES TO WALLS"; 600; 150; 500; "CANCEL"; "CREATE"; }
code_block_2 = CodeBlock { "SELECT CATEGORY"; "SELECT VIEW"; }
categories_listall = Custom[[&] Categories.ListAll]()  # package Ampersand; List of all Revit Categories
dropdown_data = Custom[DropDown Data](InputName=code_block_2.out0, Keys=categories_listall.names, Values=categories_listall.categories)  # package Data-Shapes; Create data for DropDown input in UI.MultiInputForm ++ . Check out www.data-shapes.net for more infos.
collector_of_views = Custom[Collector of Views]()  # package Genius Loci; Collects all views in the active or given document.
name = Element.Name(element=collector_of_views.View)
dropdown_data_2 = Custom[DropDown Data](InputName=code_block_2.out1, Keys=name, Values=collector_of_views.View)
code_block_3 = CodeBlock { "WALL TYPE"; "Precast Solid Wall 150mm"; }
textbox_data = Custom[TextBox Data](InputName=code_block_3.out0, DefaultText=code_block_3.out1)  # package Data-Shapes; Create Data for TextBox input in UI.MultipleInputForm ++ . Check out www.data-shapes.net for more informations
code_block_4 = CodeBlock { "WALL NAME"; "BS1-GF-IPP15-"; }
textbox_data_2 = Custom[TextBox Data](InputName=code_block_4.out0, DefaultText=code_block_4.out1)
list_create = List.Create(item0=dropdown_data, item1=dropdown_data_2, item2=textbox_data, item3=textbox_data_2)
boolean = BoolSelector(true)
multipleinputform = Custom[MultipleInputForm ++](Description_optional=code_block.out0, ButtonText_optional=code_block.out5, Inputs=list_create, Toggle=boolean, CancelButtonText_optional=code_block.out4, MaxHeight_optional=code_block.out1, Width_optional=code_block.out3, LabelWidth_optional=code_block.out2)  # package Data-Shapes; Create a form with multiple inputs. see www.data-shapes.net for tutorials and infos!
code_block_5 = CodeBlock(out=multipleinputform.User_Inputs) { cwall = out[0]; view = out[1]; Wtype = out[2]; fname = out[3]; }

# group: collect walls
all_elements_of_category_in_view = ElementsOfCategoryInView(Category=code_block_5.cwall, View=code_block_5.view)
name_2 = Element.Name(element=all_elements_of_category_in_view)
contains = String.Contains(string=name_2, searchFor=code_block_5.Wtype)
filterByBoolMask = List.FilterByBoolMask(list=all_elements_of_category_in_view, mask=contains)
code_block_6 = CodeBlock { "Mark"; }
getParameterValueByName = Element.GetParameterValueByName(element=filterByBoolMask.in, parameterName=code_block_6)
code_block_7 = CodeBlock { i=null; }
not_ = Not(x=code_block_7)
eq = getParameterValueByName == not_
filterByBoolMask_2 = List.FilterByBoolMask(list=filterByBoolMask.in, mask=eq)
code_block_8 = CodeBlock { i=null; }
not_2 = Not(x=code_block_8)
eq_2 = getParameterValueByName == not_2
filterByBoolMask_3 = List.FilterByBoolMask(list=getParameterValueByName, mask=eq_2)
sortByKey = List.SortByKey(list=filterByBoolMask_2.in, keys=filterByBoolMask_3.in)
filterByBoolMask_4 = List.FilterByBoolMask(list=sortByKey.sortedList, mask=eq)
flatten = List.Flatten(list=filterByBoolMask_4.in)

# group: Assign Name
code_block_9 = CodeBlock { 001; }
count = List.Count(list=flatten)
range = Range(start=code_block_9, end=count)
string_from_object = FromObject(object=range)
code_block_10 = CodeBlock { 3; }
code_block_11 = CodeBlock { "0"; }
padLeft = String.PadLeft(string=string_from_object, newLength=code_block_10, padChars=code_block_11)
add = code_block_5.fname + padLeft
flatten_2 = List.Flatten(list=add)

# group: Set Name
code_block_12 = CodeBlock { "Comments"; }
setParameterByName = Element.SetParameterByName(element=flatten, parameterName=code_block_12, value=flatten_2)
