# Dynamo graph Replacing Title Block_script.dyn (Dynamo 3.3.0.6316)
# packages: Clockwork for Dynamo 3.x 3.3.0, Data-Shapes 2025.3.119

# group: COLLECT TITLE BLOCK
code_block = CodeBlock { "TEMPLATE TITLEBLOCK"; }
categories = Categories("OST_TitleBlocks")
all_family_types_of_category = Custom[All Family Types Of Category](category=categories)  # package Clockwork for Dynamo 3.x; Gets all family types/symbols of a given category in the model.
name = Element.Name(element=all_family_types_of_category)
dropdown_data = Custom[DropDown Data](InputName=code_block, Keys=name, Values=all_family_types_of_category)  # package Data-Shapes; Create data for DropDown input in UI.MultiInputForm ++ . Check out www.data-shapes.net for more infos.

# group: COLLECT SHEETS
code_block_2 = CodeBlock { "SLECET SHEETS"; 400; }
categories_2 = Categories("OST_Sheets")
all_elements_of_category = ElementsOfCategory(Category=categories_2)
sheetNumber = Sheet.SheetNumber(sheet=all_elements_of_category)
titleBlock = Sheet.TitleBlock(sheet=all_elements_of_category)
flatten = List.Flatten(list=titleBlock)
code_block_3 = CodeBlock(a=sheetNumber, b=flatten) { a+"-"+b; }
boolean = BoolSelector(false)
listview_data = Custom[Listview Data](InputName=code_block_2.out0, Keys=code_block_3, Values=flatten, Height_optionnal=code_block_2.out1, SortItems_optionnal=boolean, ShowId_optionnal=boolean)  # package Data-Shapes; Create data for ListView input in UI.MultiInputForm ++ . Check out www.data-shapes.net for more infos.

# group: UI
code_block_4 = CodeBlock { "REPLACING TITLE BLOCK"; "CANCEL"; "UPDATE"; 700; 500; 80; }
list_create = List.Create(item0=dropdown_data, item1=listview_data)
boolean_2 = BoolSelector(true)
multipleinputform = Custom[MultipleInputForm ++](Description_optional=code_block_4.out0, ButtonText_optional=code_block_4.out1, Inputs=list_create, Toggle=boolean_2, CancelButtonText_optional=code_block_4.out2, MaxHeight_optional=code_block_4.out3, Width_optional=code_block_4.out4, LabelWidth_optional=code_block_4.out5)  # package Data-Shapes; Create a form with multiple inputs. see www.data-shapes.net for tutorials and infos!

# group: REPLACE TITLEBLOCK
code_block_5 = CodeBlock(x=multipleinputform.User_Inputs) { x[0]; x[1]; }
code_block_6 = CodeBlock { "Type"; }
setParameterByName = Element.SetParameterByName(element=code_block_5.out1, parameterName=code_block_6, value=code_block_5.out0)
