# Dynamo graph Update title Block paramters_script.dyn "Update title Block paramters" (Dynamo 3.3.0.6316)
# packages: Data-Shapes 2025.3.119

# group: COLLECT SHEETS
code_block = CodeBlock { "SELECT SHEETS"; 600; false; }
categories = Categories("OST_Sheets")
all_elements_of_category = ElementsOfCategory(Category=categories)
code_block_2 = CodeBlock { "Assembly: Name"; }
getParameterValueByName = Element.GetParameterValueByName(element=all_elements_of_category, parameterName=code_block_2)
code_block_3 = CodeBlock { ""; }
eq = getParameterValueByName == code_block_3
filterByBoolMask = List.FilterByBoolMask(list=getParameterValueByName, mask=eq)
filterByBoolMask_2 = List.FilterByBoolMask(list=all_elements_of_category, mask=eq)
listview_data = Custom[Listview Data](InputName=code_block.out0, Keys=filterByBoolMask.out, Values=filterByBoolMask_2.out, HilightInView_optionnal=code_block.out1, ShowId_optionnal=code_block.out2)  # package Data-Shapes; Create data for ListView input in UI.MultiInputForm ++ . Check out www.data-shapes.net for more infos.

# group: PARAMTER VALUES
code_block_4 = CodeBlock { "Drawn By"; "Checked By"; "Sheet Issue Date"; "Designed By"; "Approved By"; }
textbox_data = Custom[TextBox Data](InputName=code_block_4.out0)  # package Data-Shapes; Create Data for TextBox input in UI.MultipleInputForm ++ . Check out www.data-shapes.net for more informations
textbox_data_2 = Custom[TextBox Data](InputName=code_block_4.out1)
textbox_data_3 = Custom[TextBox Data](InputName=code_block_4.out2)
textbox_data_4 = Custom[TextBox Data](InputName=code_block_4.out3)
textbox_data_5 = Custom[TextBox Data](InputName=code_block_4.out4)

# group: UI
code_block_5 = CodeBlock { "TITLE BLOCK UPDATE"; "CANCEL"; "UPDATE"; 550; 150; 350; }
list_create = List.Create(item0=listview_data, item1=textbox_data, item2=textbox_data_2, item3=textbox_data_3, item4=textbox_data_4, item5=textbox_data_5)
boolean = BoolSelector(true)
multipleinputform = Custom[MultipleInputForm ++](Description_optional=code_block_5.out0, ButtonText_optional=code_block_5.out2, Inputs=list_create, Toggle=boolean, CancelButtonText_optional=code_block_5.out1, MaxHeight_optional=code_block_5.out3, Width_optional=code_block_5.out5, LabelWidth_optional=code_block_5.out4)  # package Data-Shapes; Create a form with multiple inputs. see www.data-shapes.net for tutorials and infos!

code_block_6 = CodeBlock(out=multipleinputform.User_Inputs) { sheets = out[0]; Drawn = out[1]; Checked = out[2]; SDate = out[3]; Designed = out[4]; Approved = out[5]; }

# group: SET PARAMETER VALUES
code_block_7 = CodeBlock { "Drawn By"; "Checked By"; "Sheet Issue Date"; "Designed By"; "Approved By"; }
setParameterByName = Element.SetParameterByName(element=code_block_6.sheets, parameterName=code_block_7.out0, value=code_block_6.Drawn)
setParameterByName_2 = Element.SetParameterByName(element=code_block_6.sheets, parameterName=code_block_7.out1, value=code_block_6.Checked)
setParameterByName_3 = Element.SetParameterByName(element=code_block_6.sheets, parameterName=code_block_7.out2, value=code_block_6.SDate)
setParameterByName_4 = Element.SetParameterByName(element=code_block_6.sheets, parameterName=code_block_7.out2, value=code_block_6.Designed)
setParameterByName_5 = Element.SetParameterByName(element=code_block_6.sheets, parameterName=code_block_7.out2, value=code_block_6.Approved)
