# Dynamo graph Placing Views on sheets_script.dyn (Dynamo 3.3.0.6316)
# packages: Data-Shapes 2025.3.119, Rhythm 2024.10.1

# group: TEMPLATE SHEET
code_block = CodeBlock { "TEMPLATE SHEET"; }
categories = Categories("OST_Sheets")
all_elements_of_category = ElementsOfCategory(Category=categories)
sheetNumber = Sheet.SheetNumber(sheet=all_elements_of_category)
dropdown_data = Custom[DropDown Data](InputName=code_block, Keys=sheetNumber, Values=all_elements_of_category)  # package Data-Shapes; Create data for DropDown input in UI.MultiInputForm ++ . Check out www.data-shapes.net for more infos.

# group: COLLECT SHEETS
code_block_2 = CodeBlock { "SELECT SHEETS"; 500; }
categories_2 = Categories("OST_Sheets")
all_elements_of_category_2 = ElementsOfCategory(Category=categories_2)
sheetNumber_2 = Sheet.SheetNumber(sheet=all_elements_of_category_2)
boolean = BoolSelector(true)
boolean_2 = BoolSelector(false)
listview_data = Custom[Listview Data](InputName=code_block_2.out0, Keys=sheetNumber_2, Values=all_elements_of_category_2, Height_optionnal=code_block_2.out1, SortItems_optionnal=boolean, ShowId_optionnal=boolean_2)  # package Data-Shapes; Create data for ListView input in UI.MultiInputForm ++ . Check out www.data-shapes.net for more infos.

# group: UI
code_block_3 = CodeBlock { "PLACING VIEWS ON SHEETS"; 500; "CANCEL"; "UPDATE"; 100; }
list_create = List.Create(item0=dropdown_data, item1=listview_data)
boolean_3 = BoolSelector(true)
multipleinputform = Custom[MultipleInputForm ++](Description_optional=code_block_3.out0, Logo_optional=code_block_3.out0, ButtonText_optional=code_block_3.out3, Inputs=list_create, Toggle=boolean_3, CancelButtonText_optional=code_block_3.out2, Width_optional=code_block_3.out1, LabelWidth_optional=code_block_3.out4)  # package Data-Shapes; Create a form with multiple inputs. see www.data-shapes.net for tutorials and infos!

# group: PLACING VIEWES
code_block_4 = CodeBlock(a=multipleinputform.User_Inputs) { a[1]; }
viewports = Sheet.Viewports(sheet=code_block_4)
transpose = List.Transpose(lists=viewports)
code_block_5 = CodeBlock(a=multipleinputform.User_Inputs) { a[0]; }
viewports_2 = Sheet.Viewports(sheet=code_block_5)
ʳʰʸᵗʰᵐ_viewport_boxcenter = Rhythm.Revit.Elements.Viewport.BoxCenter(viewport=viewports_2)
setBoxCenter = Viewport.SetBoxCenter(viewport=transpose, point=ʳʰʸᵗʰᵐ_viewport_boxcenter)
