# Dynamo graph Worksets_script.dyn (Dynamo 3.3.0.6316)
# packages: BVN 1.6.1, Data-Shapes 2026.4.0

# group: COLLECT WORKSETS
code_block = CodeBlock { "SELECT WORKSETS"; 450; false; }
code_block_2 = CodeBlock()
# ---------- code_block_2.designscript (40 lines) ----------
"AR-Civil Works-GF";
"AR-Civil Works-FF";
"LINK-CAD-ST";
"LINK-RVT-AR";
"LINK-RVT-EL";
"LINK-RVT-GN";
"LINK-RVT-ID";
"LINK-RVT-LA";
"LINK-RVT-ME";
"LINK-RVT-PL";
"LINK-RVT-ST";
"ST-WALL-RF";
"ST-Beam-FF";
"ST-Beam-RF";
"ST-BLOCK WALL-FF";
"ST-BLOCK WALL-GF";
"ST-BLOCK WALL-PA";
"ST-CIP-FF";
"ST-CIP-RF";
"ST-Column-FF";
"ST-Column-GF";
"ST-Erection Mark-FF";
"ST-Erection Mark-GF";
"ST-Erection Mark-RF";
"ST-Foundation";
"ST-Hollowcore-FF";
"ST-Hollowcore-RF";
"ST-Reveals-FF";
"ST-Reveals-GF";
"ST-Reveals-RF";
"ST-SLAB-FF";
"ST-SLAB-GF";
"ST-SLAB-RF";
"ST-STAIR-FF";
"ST-STAIR-GF";
"ST-Stru Opngs-FF";
"ST-Stru Opngs-RF";
"ST-WALL-FF";
"ST-WALL-GF";
"AR-Civil Works-RF";
# ----------------------------------------
list_create = List.Create(item0=code_block_2.out0, item1=code_block_2.out1, item2=code_block_2.out2, item3=code_block_2.out3, item4=code_block_2.out4, item5=code_block_2.out5, item6=code_block_2.out6, item7=code_block_2.out7, item8=code_block_2.out8, item9=code_block_2.out9, item10=code_block_2.out10, item11=code_block_2.out11, item12=code_block_2.out12, item13=code_block_2.out13, item14=code_block_2.out14, item15=code_block_2.out15, item16=code_block_2.out16, item17=code_block_2.out17, item18=code_block_2.out18, item19=code_block_2.out19, item20=code_block_2.out20, item21=code_block_2.out21, item22=code_block_2.out22, item23=code_block_2.out23, item24=code_block_2.out24, item25=code_block_2.out25, item26=code_block_2.out26, item27=code_block_2.out27, item28=code_block_2.out28, item29=code_block_2.out29, item30=code_block_2.out30, item31=code_block_2.out31, item32=code_block_2.out32, item33=code_block_2.out33, item34=code_block_2.out34, item35=code_block_2.out35, item36=code_block_2.out36, item37=code_block_2.out37, item38=code_block_2.out38, item39=code_block_2.out39)
listview_data = Custom[Listview Data](InputName=code_block.out0, Keys=list_create, Values=list_create, Height_optionnal=code_block.out1, ShowId_optionnal=code_block.out2)  # package Data-Shapes; Create data for ListView input in UI.MultiInputForm ++ . Check out www.data-shapes.net for more infos.

# group: UI
code_block_3 = CodeBlock { "CREATE WORKSETS"; "CREATE"; "CANCEL"; 550; 100; 350; }
boolean = BoolSelector(true)
multipleinputform = Custom[MultipleInputForm ++](Description_optional=code_block_3.out0, ButtonText_optional=code_block_3.out1, Inputs=listview_data, Toggle=boolean, CancelButtonText_optional=code_block_3.out2, MaxHeight_optional=code_block_3.out3, Width_optional=code_block_3.out5, LabelWidth_optional=code_block_3.out4)  # package Data-Shapes; Create a form with multiple inputs. see www.data-shapes.net for tutorials and infos!

# group: CREATE WORKSETS
flatten = List.Flatten(list=multipleinputform.User_Inputs@L1)
createAndRenameDefault = Custom[Workset.CreateAndRenameDefault](newWorksetNames=flatten)  # package BVN; Creates new worksets from a list as well as renaming the default worksets (Shared levels and grids, and Workset 1)
